# Grasshopper definition FINAL.gh (Grasshopper 1.0.7)

# ---- group: VARIATIONS
projections = Panel("4")
grid_axis = Panel("1")

# ----
positioning = Panel("0,0,0")

# ---- group: SCALE
overall_scale = Panel("1")
overal_scale = Panel("3.2")

# ---- group: PANEL TYPE
panel_edges = Panel("4")
panel_stretch = Panel("2.5")

# ---- group: INDIVIDUAL PANEL ROTATION AND ANGLE
number_slider = Slider(24, range=0..100)
panel = Panel("135")

# ----
panel_height = Panel("3")

# ---- group: ATTACH SURFACE HERE
surface = Surface(<surface referenced from the Rhino model>)

# ---- group: PANEL ANGLES
panel_2 = Panel("135")

# ---- group: GRID SYSTEM
division = Division(A=overal_scale, B=overall_scale)
series = Series(Start=overal_scale, Step=projections, Count=grid_axis)
panel_3 = Panel(division)
construct_point = ConstructPoint(XCoordinate=series, YCoordinate=graft(series), ZCoordinate=0)
point = Point(positioning)
vector_2pt = Vector2Pt(PointA=flatten(construct_point), PointB=point, Unitize=False)  # -> Vector, Length
reverse = Reverse(Vector=vector_2pt.Vector)

# ---- group: POLYGON
polygon = Polygon(Plane=positioning, Radius=panel_3, Segments=panel_edges, FilletRadius=0)  # -> Polygon, Length
scale_nu = ScaleNU(Geometry=polygon.Polygon, Plane=PlaneXY(0, 0, 0), ScaleX=1, ScaleY=panel_stretch, ScaleZ=1)  # -> Geometry, Transform
division_2 = Division(A=panel_3, B=panel_height)
scale = Scale(Geometry=scale_nu.Geometry, Center=Point(0, 0, 0), Factor=0.5)  # -> Geometry, Transform
unit_z = UnitZ(Factor=division_2)
boundary_surfaces = BoundarySurfaces(Edges=[scale_nu.Geometry, scale.Geometry])
extrude = Extrude(Base=boundary_surfaces, Direction=unit_z)
cap_holes = CapHoles(Brep=extrude)

# ----
move = Move(Geometry=graft(cap_holes), Motion=reverse)  # -> Geometry, Transform

# ---- group: ROTATION
polar_array = PolarArray(Geometry=move.Geometry, Plane=PlaneXY(0, 0, 0), Count=number_slider, Angle=degrees(panel))  # -> Geometry, Transform

# ----
geometry = Geometry(polar_array.Geometry)

volume = Volume(Geometry=geometry)  # -> Volume, Centroid
divide_surface = DivideSurface(Surface=surface, UCount="7", VCount="14")  # -> Points, Normals, Parameters
surface_closest_point = SurfaceClosestPoint(Point=divide_surface.Points, Surface=surface)  # -> Point, UVPoint, Distance
xy_plane = XYPlane(Origin=volume.Centroid)
evaluate_surface = EvaluateSurface(Surface=surface, Point=surface_closest_point.UVPoint)  # -> Point, Normal, UDirection, VDirection, Frame
orient = Orient(Geometry=geometry, Source=xy_plane, Target=evaluate_surface.Frame)  # -> Geometry, Transform
unit_x = UnitX(Factor=1)
rotate_3d = Rotate3D(Geometry=orient.Geometry, Angle=panel_2, Center=divide_surface.Points, Axis=unit_x)  # -> Geometry, Transform

brep = Brep(rotate_3d.Geometry)

# ---- group: COLOR
deconstruct_brep = DeconstructBrep(Brep=brep)  # -> Faces, Edges, Vertices
area = Area(Geometry=deconstruct_brep.Faces)  # -> Area, Centroid
deconstruct = Deconstruct(Point=area.Centroid)  # -> XComponent, YComponent, ZComponent
sort_list = SortList(Keys=deconstruct.ZComponent, ValuesValuesA=deconstruct_brep.Faces)  # -> Keys, ValuesValuesA
reverse_list = ReverseList(List=sort_list.ValuesValuesA)
panel_4 = Panel("101")
panel_5 = Panel("119")
panel_6 = Panel("175")
stream_filter = StreamFilter(Gate=Toggle(False), Stream0=sort_list.ValuesValuesA, Stream1=reverse_list)

list_length = ListLength(List=deconstruct_brep.Faces)
division_3 = Division(A="1", B=list_length)
series_2 = Series(Start=0, Step=division_3, Count=list_length)
linear_color_gradient = GhPythonScript(R="255", G="173", B="0", Percent=series_2, R1=panel_4, R2=panel_5, R3=panel_6)  # -> Color
# ---------- linear_color_gradient: Python ----------
__author__ = "ericsonm"
__version__ = "2021.04.12"

import rhinoscriptsyntax as rs

def LinearColor(R,G,B,R2,G2,B2,ColorPercentage):
    
    #This function defines linear color gradient by treating R,G,B as coordinates on a 3D line.
    #The base color that will be altered by the percentage should be entered in the second R2,G2,B2 valu
    
    Rdiff = float(R2 - R)
    Gdiff = float(G2 - G)
    Bdiff = float(B2 - B)


    t = float(ColorPercentage)


    R3 = float(R + Rdiff*t)
    G3 = float(G + Gdiff*t)
    B3 = float(B + Bdiff*t)

    Color = rs.CreateColor(R3,G3,B3)
    return (Color)

if (R or G or B or Percent) is None:
    Color = None
else:
    
    Color = LinearColor(R1,R2,R3,R,G,B,Percent)
# ---------- end linear_color_gradient ----------

# ----
custom_preview = CustomPreview(Geometry=stream_filter, Material=linear_color_gradient)
